# Grasshopper definition hairworm_basic_example.ghx (Grasshopper 0.9.64)
# plug-ins: Hairworm

# https://github.com/provolot/GrasshopperExchange/raw/master/Hairworm/_example_files/TypedParamTest.ghx
# https://github.com/provolot/GrasshopperExchange/raw/master/Hairworm/_example_files/SphereMaker.ghcluster
# https://raw.github.com/provolot/GrasshopperExchange/master/Hairworm/_example_files/BoxSphereMakerVariableghx.ghx
# https://github.com/provolot/GrasshopperExchange/raw/master/Hairworm/_example_files/NestedSpheres.ghx
panel = Panel("https://github.com/provolot/GrasshopperExchange/raw/master/Hairworm/_example_files/HexagridOnSrf.ghx")
# https://github.com/provolot/GrasshopperExchange/raw/master/Hairworm/_example_files\RandomSphereMaker.ghx
panel_2 = Panel("https://github.com/provolot/GrasshopperExchange/raw/master/Hairworm/_example_files\WormholeMaker.ghx")
number_slider = Slider(33, range=0..100)
panel_3 = Panel("3")
geo = Geometry(<brep referenced from the Rhino model>)
number_slider_2 = Slider(10, range=0..10)
number_slider_3 = Slider(4, range=0..10)
hairworm_hexagridonsrf = HairwormHexagridOnSrf(ClusterURL=panel, S=geo, Ex=number_slider_3, Ey=number_slider_3)  # -> Debug, Output, C, P
geo_2 = Geometry(flatten(hairworm_hexagridonsrf.P))
jitter = Jitter(List=geo_2, Jitter=1, Seed=2)  # -> Values, Indices
dispatch = Dispatch(List=jitter.Values, DispatchPattern=[True, False])  # -> ListA, ListB
short = ShortestList(ListA=dispatch.ListA, ListB=dispatch.ListB, TrimMode=2)  # -> ListA, ListB
hairworm_wormholemaker = HairwormWormholeMaker(ClusterURL=panel_2, Point=short.ListA, Point_2=short.ListB, Number=Slider(9, range=0..10))  # -> Debug, Geometry
colour = ColourPicker(PickedColour=RGB(67, 180, 232))
geo_3 = Geometry()
preview = CustomPreview(Geometry=geo_3, Shader=colour)
